# Dynamo custom node floodfxn.dyf (Dynamo 2.17.0.3472)
# category: Revit
# packages: Clockwork for Dynamo 2.x 2.6.0

# group: Inputs
element = Input(element: var[]..[])
parameter = Input(parameter: var[]..[])
value = Input(value: var[]..[])

# group: CHANGE WATER HEIGHT
setParameterByName = Element.SetParameterByName(element=element, parameterName=parameter, value=value)

# group: Image Renaming
# Tidies up stirng, creating cohesive output.
filepath = Input(filepath: var[]..[])
string_from_object = FromObject(object=value)
string = StringInput(".")
string_2 = StringInput("-")
replace = String.Replace(string=string_from_object, searchFor=string, replaceWith=string_2)
concat = String.Concat(string0=filepath, string1=replace)

# group: SCREENSHOT
# Saves screenshot of active Revit view to the file path specified by the user.
current = Document.Current()
activeView = Document.ActiveView(document=current)
exportAsImage = View.ExportAsImage(view=activeView, path=concat)

# group: SCREENSHOT AFTER CHANGING WATER HEIGHT
# Ensures correct order of outputs
end = Revit.Transaction.Transaction.End(input=setParameterByName)
passthrough = Custom[Passthrough](passThrough=end, waitFor=exportAsImage)  # package Clockwork for Dynamo 2.x; Forces a sequential order of execution. The node wired into the output of the Passthrough node will be executed *after* the node wired into the waitFor input (e.g. important for some Revit operations). The value of the passThrough input will be passed on to the node wired into the output port of the Passthrough node.
