# Dynamo graph floodrising.dyn (Dynamo 2.17.0.3472)

# group: INPUT EXCEL FILE
# Select "Browse" and select file with water plane data
file_path = Filename("C:\Users\bak11\Documents\TC DOC\hss.xlsx")

# group: READ IN EXCEL > INPUT EXCEL SHEET NAME
string = StringInput("waterlevels")

# group: READ IN EXCEL
file_from_path = FileObject(path=file_path)
importExcel = Data.ImportExcel(file=file_from_path, sheetName=string)

# group: GET CLEAN VALUES FROM EXCEL
# Water level values should be located in the first column. The first row of that column (cell A1) should read "Level"
clean = List.Clean(list=importExcel)
restOfItems = List.RestOfItems(list=clean)
clean_2 = List.Clean(list=restOfItems)
firstItem = List.FirstItem(list=clean)
code_block = CodeBlock { "Level"; }
indexOf = List.IndexOf(list=firstItem, element=code_block)
getItemAtIndex = List.GetItemAtIndex(list=clean_2@L2, index=indexOf)

# group: FILE PATH
# Rename string for applicable file path
string_2 = StringInput("C:\Users\bak11\Documents\TC DOC\Outputs\HSS_")

# group: SELECT WATER TOPOSOLID
# Select "Change", and then (in Revit) select the water toposolid
select_model_element = DSModelElementSelection()  # 1 picked in the model

# group: CHANGE WATER HEIGHT
string_3 = StringInput("Height Offset From Level")

# group: FLOOD FUNCTION
# Function that updates model & outputs images given user input
floodfxn = Custom[floodfxn](filepath=string_2, element=select_model_element, parameter=string_3)  # unwired: value

# group: RUN FUNCTION FOR EACH ITEM IN LIST
# Based off excel input
map = List.Map(list=getItemAtIndex, function=floodfxn)
